# Grasshopper definition multiLayerArt.gh (Grasshopper 1.0.7)

pt = ConstructPoint(XCoordinate=0, YCoordinate=0, ZCoordinate=0)
rectangle = Rectangle(Plane=PlaneXY(0, 0, 0), XSize=Slider(38.455, range=0..100), YSize=Slider(10, range=0..10), Radius=0)  # -> Rectangle, Length
vec = VectorXYZ(XComponent=217.66, YComponent=43.87769411, ZComponent=0)  # -> Vector, Length
move = Move(Geometry=rectangle.Rectangle, Motion=vec.Vector)  # -> Geometry, Transform
boundary = BoundarySurfaces(Edges=move.Geometry)

# ---- group: Input curves
crv = Curve([<curve referenced from the Rhino model> x8])
cls = Closed(Curve=crv)  # -> Closed, Periodic
cull = CullPattern(List=crv, CullPattern=cls.Closed)
area = Area(Geometry=cull)  # -> Area, Centroid
number_slider = Slider(0, range=0..100)

# ----
sort = SortList(Keys=area.Area, ValuesA=cull)  # -> Keys, reverse(ValuesA)

# ---- group: Input curves (continued)
larger = LargerThan(FirstNumber=sort.ValuesA, SecondNumber=Slider(10, range=0..2000))  # -> LargerThan, OrEqualTo
cull_2 = CullPattern(List=sort.ValuesA, CullPattern=larger.LargerThan)
cull_i = CullIndex(List=cull_2, Indices=number_slider, Wrap=True)
item = ListItem(List=cull_2, Index=number_slider, Wrap=True)
midpt = CurveMiddle(Curve=cull_i)
points = PointList(Points=midpt, Size=Slider(5, range=0..10))

# ----
item_2 = ListItem(List=cull_i, Index=Slider(2, range=0..10), Wrap=True)
boundary_2 = BoundarySurfaces(Edges=item_2)
join = BrepJoin(Breps=[boundary, boundary_2])  # -> Breps, Closed

# ---- group: Generate cutouts
frame_thickness = Slider(20, range=0..20)
panel = Panel("""[
{"out": [0], "in": [4, 5, 6]}, 
{"out": [2, 1], "in": []},
{"out": [3], "in": []},
]""")
bbox = BoundingBox(Content=item, Plane=PlaneXY(0, 0, 0))  # -> Box, Box_2
boundary_3 = BoundarySurfaces(Edges=item)
offset = OffsetCurve(Curve=item, Distance=frame_thickness, Corners=1)
debox = DeconstructBox(Box=bbox.Box)  # -> Plane, X, Y, Z
python = GhPythonScript(
    shapes=flatten(cull_i),
    outerFrame=offset,
    innerFrame=boundary_3,
    x=debox.X,
    y=debox.Y,
    groups=panel,
    tabWidth=Slider(5, range=0..10))  # -> out, outlines, numLayer; inputs shapes: list
# ---------- python: Python ----------
"""Provides a scripting component.
    Inputs:
        shapes: list of curves in the image
        outerFrame: outer frame of the image (curve)
        innerFrame: inner frame of the image (srf)
        x: inner x dimension of the frame
        y: inner y dimension of the frame
        groups: list of lists specifying which shapes are in each layer, 
            the first in each of the inner list is the outermost shape of that layer
        tabWidth: width of the tabs connecting the shapes to the frame
    Output:
        outlines: outlines for each layer """

__author__ = "xiwe7299"

import rhinoscriptsyntax as rs
from Rhino.Geometry import AreaMassProperties, Line, Brep
from ghpythonlib import treehelpers

def findCurveCentroid(guid):
    curve = rs.coercecurve(guid)
    return AreaMassProperties.Compute(curve).Centroid
    
def connectToClosestEdge(shape):
    edgeFrom = shape.closestEdge.From
    edgeTo = shape.closestEdge.To
    # edge is parallel to Y-axis 
    if edgeFrom[0] == edgeTo[0]:
        tab = rs.AddRectangle(rs.WorldXYPlane(), shape.distanceToClosestEdge, tabWidth)
        ToY = shape.centroid[1]
        ToX = (edgeFrom[0] + shape.centroid[0])/2
        print(shape.distanceToClosestEdge, tabWidth)
        print(ToY, ToX)
    # edge is parallel to X-axis
    else: 
        tab = rs.AddRectangle(rs.WorldXYPlane(), tabWidth, shape.distanceToClosestEdge)
        ToX = shape.centroid[0]
        ToY = (edgeFrom[1] + shape.centroid[1])/2
    translateVector = rs.VectorCreate((ToX, ToY, 0), findCurveCentroid(tab))
    movedTab = rs.CopyObject(tab, translateVector)

    return movedTab
    
class ShapeInFrame:
    def __init__(self, guid, boundingX, boundingY):
        self.guid = guid
        self.curve = rs.coercecurve(guid)
        amp = AreaMassProperties.Compute(self.curve)
        self.centroid = amp.Centroid
        self.closestEdge = None 
        self.distanceToClosestEdge = 0
        self.frameX = boundingX
        self.frameY = boundingY
        self.frameEdges = [
            Line(self.frameX.Min, self.frameY.Min, 0, self.frameX.Max, self.frameY.Min, 0), 
            Line(self.frameX.Min, self.frameY.Max, 0, self.frameX.Max, self.frameY.Max, 0), 
            Line(self.frameX.Min, self.frameY.Min, 0, self.frameX.Min, self.frameY.Max, 0), 
            Line(self.frameX.Max, self.frameY.Min, 0, self.frameX.Max, self.frameY.Max, 0)
            ]
    
    # returns distance to the edge closest to the centroid of the shape and this edge
    def findClosestEdge(self):
        smallestDist = 1000000
        cloesetEdge = None
        for e in self.frameEdges:
            dist = e.DistanceTo(self.centroid, False)
            if smallestDist >= dist:
                smallestDist = dist
                cloesetEdge = e
        self.closestEdge = cloesetEdge 
        self.distanceToClosestEdge = smallestDist
        return (smallestDist, cloesetEdge)

outlinesList = []            
g = eval(groups)
# each group represent a layer
for group in g:
    # outer shapes are the ones connected to the frame by tab
    outlinesInLayer = []
    for outerIndex in group["out"]:
        outerShape = ShapeInFrame(shapes[outerIndex], x, y)
        outerShape.findClosestEdge()
        tab = connectToClosestEdge(outerShape)
        srfs = rs.AddPlanarSrf([tab, outerShape.guid])
        
        #union = rs.BooleanUnion(srfs)
        outlinesInLayer += srfs
    outlinesList.append(outlinesInLayer)
outlines = treehelpers.list_to_tree(outlinesList)
numLayer = len(g)
print(outlines)
# ---------- end python ----------

# ----
X = UnitX(Factor=expr("-x", frame_thickness))
move_2 = Move(Geometry=pt, Motion=X)  # -> Geometry, Transform
boundary_4 = BoundarySurfaces(Edges=offset)
ln = Line(StartPoint=pt, EndPoint=move_2.Geometry)
mod = Modulus(A=Slider(2, range=0..4), B=python.numLayer)
textsrf = TextOnSurface(Text=mod, Font="Sans Bold:no Italic:no", Height=5, Depth=0, BaseLine=ln, BaseSurface=boundary_4)
branch = TreeBranch(Tree=simplify(python.outlines), Path=mod, MaintainPaths=True)
panel_2 = Panel(python.outlines)
rdiff = RegionDifference(CurvesA=boundary_3, CurvesB=join.Breps)

# ---- group: Generate cutouts (continued)
python_2 = GhPythonScript(shapes=flatten(cull_i), groups=panel, layer=mod)  # -> out, currentLayer; inputs shapes: list, layer: Int32
# ---------- python_2: Python ----------
"""Provides a scripting component.
    Inputs:
        shapes: list of curves in the image
        groups: list of lists specifying which shapes are in each layer, 
            the first in each of the inner list is the outermost shape of that layer
        layer: index of the current layer
    Output:
        currentLayer: shapes for the current layer"""

__author__ = "xiwe7299"

import rhinoscriptsyntax as rs

currentLayer = []
g = eval(groups)
layerIndex = layer % len(g)

innerShapesInGroup = g[layerIndex]["in"]
currentLayer = [shapes[i] for i in innerShapesInGroup]

print(currentLayer)
# ---------- end python_2 ----------
rdiff_2 = RegionDifference(CurvesA=boundary_3, CurvesB=branch)

# ----
python_3 = GhPythonScript(x=rdiff_2, y=branch)  # -> out, a
# ---------- python_3: Python ----------
__author__ = "xiwe7299"

import rhinoscriptsyntax as rs

if y != None: 
    a = x 
else:
    a = None
# ---------- end python_3 ----------

# ---- group: Generate cutouts (continued)
group = Group(Objects=[offset, python_2.currentLayer, python_3.a, textsrf])
